# Grasshopper definition FACADE_DESIGN.gh (Grasshopper 1.0.7)

# ---- group: Inputs
length = GetInteger(Slider(30, range=10..1000), AtLeast=1, AtMost=1, Maximum=2147483647, Minimum=-2147483648, TreeAccess=False)
hight = GetInteger(Slider(10, range=3..10), AtLeast=1, AtMost=1, Maximum=2147483647, Minimum=-2147483648, TreeAccess=False)
U = GetInteger(Slider(47, range=0..100), AtLeast=1, AtMost=1, Maximum=2147483647, Minimum=-2147483648, TreeAccess=False)
n_points = GetInteger(Slider(3, range=0..100), AtLeast=1, AtMost=1, Maximum=2147483647, Minimum=-2147483648, TreeAccess=False)
V = GetInteger(Slider(23, range=0..100), AtLeast=1, AtMost=1, Maximum=2147483647, Minimum=-2147483648, TreeAccess=False)

# ----
rectangle = Rectangle(Plane=PlaneXY(0, 0, 0), XSize=length, YSize=hight, Radius=0)  # -> Rectangle, Length
boundary = BoundarySurfaces(Edges=rectangle.Rectangle)
divide = DivideDomain²(Domain=boundary, UCount=U, VCount=V)
subsrf = Isotrim(Surface=boundary, Domain=divide)
area = Area(Geometry=subsrf)  # -> Area, Centroid
pop2d = Populate2D(Region=rectangle.Rectangle, Count=n_points, Seed=1)
graft = GraftTree(Tree=area.Centroid, IncludeEmptyLists=True, IncludeNullItems=True)
dist = Distance(PointA=graft, PointB=pop2d)
graph = GraphMapper(dist, x0=0, x1=10, y0=0, y1=10, container_name="Gaussian", factor=1, mean=0.7251615524, sdev=0.3370433152)
ma = MassAddition(Input=graph)  # -> Result, PartialResult
bnd = Bounds(Numbers=flatten(ma.Result))
remap = RemapNumbers(Value=ma.Result, Source=bnd, Target="0 to 90")  # -> flatten(Mapped), Clipped
yz = YZPlane(Origin=Point(0, 0, 0))
rot3d = Rotate3D(Geometry=subsrf, Angle=degrees(remap.Mapped), Center=area.Centroid, Axis=yz)  # -> Geometry, Transform
xz = XZPlane(Origin=Point(0, 0, 0))
orient = Orient(Geometry=rot3d.Geometry, Source=PlaneXY(0, 0, 0), Target=xz)  # -> Geometry, Transform

# ---- group: RH_OUT:Panels
geo = Geometry(orient.Geometry)
